# Grasshopper definition hs_app.gh (Grasshopper 1.0.8)
# plug-ins: Hops

# ----
# /add
hops = Hops(
    A=Slider(2, range=0..10),
    B=Slider(3, range=0..10),
    CacheResultsInMemory=False,
    CacheSolveResults=False,
    RemoteDefinitionLocation="http://127.0.0.1:5000/add",
    RemoteSolveVersion=(0, 1, 0),
    ShowInput_Enabled=False,
    ShowInput_Path=False,
    SynchronousSolve=True)

panel = Panel(hops)
