# Grasshopper definition hs_dataStructure.gh (Grasshopper 1.0.8)
# plug-ins: Hops

panel = Panel("""1
2
3
4""")
panel_2 = Panel("""1
2
3
4""")
panel_3 = Panel("""2
4
6
8""")
entwine = Entwine(Branch00=panel_2, Branch01=panel_3, FlattenInputs=True)

# ----
# /getList
hops = Hops(
    DataAsList=panel,
    CacheResultsInMemory=False,
    CacheSolveResults=False,
    RemoteDefinitionLocation="http://127.0.0.1:5000/getList",
    RemoteSolveVersion=(0, 1, 0),
    ShowInput_Enabled=False,
    ShowInput_Path=False,
    SynchronousSolve=True)  # -> DataAsList, Averages

# ----
# /getItem
hops_2 = Hops(
    DataAsItemA=Slider(2, range=0..10),
    DataAsItemB=[Slider(3, range=0..10), Slider(6, range=0..10)],
    CacheResultsInMemory=False,
    CacheSolveResults=False,
    RemoteDefinitionLocation="http://127.0.0.1:5000/getItem",
    RemoteSolveVersion=(0, 1, 0),
    ShowInput_Enabled=False,
    ShowInput_Path=False,
    SynchronousSolve=True)

# ----
# /getTree
hops_3 = Hops(
    DataAsTree=entwine,
    CacheResultsInMemory=False,
    CacheSolveResults=False,
    RemoteDefinitionLocation="http://127.0.0.1:5000/getTree",
    RemoteSolveVersion=(0, 1, 0),
    ShowInput_Enabled=False,
    ShowInput_Path=False,
    SynchronousSolve=True)  # -> DataAsTree, Averages

panel_4 = Panel(hops_2)
panel_5 = Panel(hops.DataAsList)
panel_6 = Panel(hops.Averages)
panel_7 = Panel(hops_3.DataAsTree)
panel_8 = Panel(hops_3.Averages)
